# Grasshopper definition AS_Dominic_CelesteVisualizer.gh (Grasshopper 1.0.7)
# plug-ins: LunchBox, Pufferfish

area_width_in = Slider(36, range=12..48)
ceiling_height_ft = Slider(8, range=7..12)
chord_distance_from_ground_ft = Slider(0.5, range=0.5..2)
area_length_in = Slider(33.1, range=12..48)
ceiling_height = GetNumber(ceiling_height_ft, AtLeast=7, AtMost=12, Maximum=1.797693135e+308, Minimum=-1.797693135e+308, TreeAccess=False)
width = GetNumber(area_width_in, AtLeast=12, AtMost=48, Maximum=1.797693135e+308, Minimum=-1.797693135e+308, TreeAccess=False)
length = GetNumber(area_length_in, AtLeast=12, AtMost=48, Maximum=1.797693135e+308, Minimum=-1.797693135e+308, TreeAccess=False)
chord_distance_from_ground = GetNumber(
    chord_distance_from_ground_ft,
    AtLeast=1,
    AtMost=2,
    Maximum=1.797693135e+308,
    Minimum=-1.797693135e+308,
    TreeAccess=False)
pattern_seed = GetNumber(Slider(55, range=0..100), AtLeast=1, AtMost=100, Maximum=1.797693135e+308, Minimum=-1.797693135e+308, TreeAccess=False)
pt = ConstructPoint(XCoordinate=0, YCoordinate=0, ZCoordinate=expr("x*12", ceiling_height))
dom = ConstructDomain(DomainStart=expr("-x/2", width), DomainEnd=expr("x/2", width))
dom_2 = ConstructDomain(DomainStart=expr("-x/2", length), DomainEnd=expr("x/2", length))
rectangle = Rectangle(Plane=pt, XSize=dom, YSize=dom_2, Radius=0)  # -> Rectangle, Length
edges = BrepEdges(Brep=rectangle.Rectangle)  # -> Naked, Interior, NonManifold
item = ListItem(List=edges.Naked, Index=0, Wrap=True)  # -> Item, Item1
len = Length(Curve=item.Item)
len_2 = Length(Curve=item.Item1)
division = Division(A=len, B="6.5")
division_2 = Division(A=len_2, B="6.5")
quads = QuadPanels(Surface=rectangle.Rectangle, UDivisions=division, VDivisions=division_2)
offset = OffsetCurve(Curve=quads, Distance="-1.5", Corners=1)
subtraction = Subtraction(A=ceiling_height, B=chord_distance_from_ground)
lng = ListLength(List=flatten(offset))
series = Series(Start=0, Step=1, Count=lng)
jitter = Jitter(List=series, Jitter=1, Seed=pattern_seed)  # -> Values, Indices
dom_3 = ConstructDomain(DomainStart=expr("x/2", ceiling_height), DomainEnd=subtraction)
pop2d = Populate2D(Region=simplify(offset), Count="1", Seed=graft(jitter.Values))
lng_2 = ListLength(List=flatten(pop2d))
multiplication = Multiplication(A=lng_2, B=0.75)
division_3 = Division(A=lng_2, B=2)
random = Random(Range=lng_2, Number=multiplication, Seed=pattern_seed)
round = Round(Number=random)  # -> Nearest, Floor, Ceiling
brep = Brep(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)
cset = CreateSet(List=round.Nearest)  # -> Set, Map
cull_i = CullIndex(List=flatten(pop2d), Indices=cset.Set, Wrap=True)
lng_3 = ListLength(List=flatten(cull_i))
random_2 = Random(Range=dom_3, Number=lng_3, Seed=2)
round_2 = Round(Number=random_2)  # -> Nearest, Floor, Ceiling
line = LineSDL(Start=cull_i, Direction="0,0,-1", Length=expr("x*12", round_2.Floor))
pipe = Pipe(Curve=line, Radius=Slider(0.05, range=0..0.1), Caps=0)
lng_4 = ListLength(List=line)
mesh = MeshBrep(
    Brep=pipe,
    Settings={GridMaxCount=0, GridMinCount=16, JaggedSeams=False, MaxEdgeLength=0, MinEdgeLength=0.0001, MinTolerance=0, Refine=True, RefineAngle=0, RelativeTolerance=0.65, SimplePlanes=True, Tolerance=0})
random_3 = Random(Range="2 to 5", Number=lng_4, Seed=2)
demesh = DeconstructMesh(Mesh=mesh)  # -> Vertices, Faces, Colours, Normals
divide = DivideCurve(Curve=line, Count=random_3, Kinks=False)  # -> Points, Tangents, Parameters
area = Area(Geometry=brep)  # -> Area, Centroid
mesh_2 = MeshBrep(
    Brep=brep,
    Settings={GridMaxCount=0, GridMinCount=16, JaggedSeams=False, MaxEdgeLength=0, MinEdgeLength=0.0001, MinTolerance=0, Refine=True, RefineAngle=0, RelativeTolerance=0.65, SimplePlanes=True, Tolerance=0})
conmesh = ConstructMesh(Vertices=demesh.Vertices, Faces=demesh.Faces, Colours=ColourSwatch(SwatchColor=RGB(28, 28, 28)))
pdecon = Deconstruct(Point=flatten(divide.Points))  # -> XComponent, YComponent, ZComponent
equals = Equality(FirstNumber=pdecon.ZComponent, SecondNumber=expr("x*12", ceiling_height))  # -> Equality, Inequality
context_bake = ContextBake(Geometry=conmesh)
cull = CullPattern(List=flatten(divide.Points), CullPattern=invert(equals.Equality))
move2pt = MoveToPoint(Geometry=mesh_2, PointA=area.Centroid, PointB=flatten(cull))  # -> Moved, Vector, Transform
neg = Negative(Value="0.656")
cyl = Cylinder(Base=cull, Radius="2.5775/2", Length=graft(["0.656", neg]))
join = BrepJoin(Breps=flatten(cyl))  # -> Breps, Closed
demesh_2 = DeconstructMesh(Mesh=move2pt.Moved)  # -> Vertices, Faces, Colours, Normals
neg_2 = Negative(Value="-0.41")
cap = CapHoles(Brep=join.Breps)
Z = UnitZ(Factor=["-0.41", neg_2])
conmesh_2 = ConstructMesh(Vertices=demesh_2.Vertices, Faces=demesh_2.Faces, Colours=ColourSwatch(SwatchColor=RGBA(145, 145, 145, 219)))
debrep = DeconstructBrep(Brep=cap)  # -> reverse(Faces), Edges, Vertices
context_bake_2 = ContextBake(Geometry=conmesh_2)
item_2 = ListItem(List=debrep.Faces, Index=0, Wrap=True)  # -> Item, Item1
area_2 = Area(Geometry=[item_2.Item, item_2.Item1])  # -> Area, Centroid
move = Move(Geometry=area_2.Centroid, Motion=Z)  # -> Geometry, Transform
item_3 = ListItem(List=move.Geometry, Index=0, Wrap=True)  # -> Item, Item1
extr = ExtrudePoint(Base=item_2.Item, Point=item_3.Item)
extr_2 = ExtrudePoint(Base=item_2.Item1, Point=item_3.Item1)
cap_2 = CapHoles(Brep=flatten([extr, extr_2]))
merge = Merge(Data1=cap, Data2=cap_2)
mesh_3 = MeshBrep(
    Brep=merge,
    Settings={GridMaxCount=0, GridMinCount=16, JaggedSeams=False, MaxEdgeLength=0, MinEdgeLength=0.0001, MinTolerance=0, Refine=True, RefineAngle=0, RelativeTolerance=0.65, SimplePlanes=True, Tolerance=0})
demesh_3 = DeconstructMesh(Mesh=mesh_3)  # -> Vertices, Faces, Colours, Normals
conmesh_3 = ConstructMesh(Vertices=demesh_3.Vertices, Faces=demesh_3.Faces, Colours=ColourSwatch(SwatchColor=RGB(64, 64, 64)))
context_bake_3 = ContextBake(Geometry=conmesh_3)
